# Grasshopper definition Beauty-of-Bezier.gh (Grasshopper 1.0.7)
# plug-ins: Mesh Pipe

pt = Point([Point(-134.1765822, -183.6471128, 0), Point(78.78091112, 34.01277438, 0), Point(41.65642471, -244.3075577, 141.5233795), Point(183.7871932, -238.0007625, 0)])
view_type = GetInteger(
    Slider(0, range=0..2),
    AtLeast=1,
    AtMost=1,
    Maximum=2,
    Minimum=0,
    Prompt="Select View Type; 0 = Skeleton View; 1 = String Art; 2=Necklace; Default=0;")

color_scheme = GetInteger(
    Slider(0, range=0..2),
    AtLeast=1,
    AtMost=1,
    Maximum=2,
    Minimum=0,
    Prompt="Select Color Scheme for String Art & Necklace View; 0 = Red/White; 1 = Black/White, 2=Rainbow; Default = 0;")
parameter_t = GetNumber(
    Slider(0, range=0..1),
    AtLeast=1,
    AtMost=1,
    Maximum=1,
    Minimum=0,
    Prompt="Set Slider with Domain 0.00 To 1.00; Parameter(t) Value Controls the Bezier Curve Amination in Skeleton View")
points = GetPoint(pt, AtLeast=4, AtMost=4, Prompt="Set Four Points", Realtime=True)

# ----
# String Art Geometry
item = ListItem(List=points, Index=0, Wrap=True)  # -> Item, Item1, Item2, Item3

number_slider = Slider(0.01, range=0..0.1)
number_slider_2 = Slider(0.24, range=0..1)

# ----
# Weighted Average
# Weight Average Spheres
expression = Expression(x=parameter_t, Expression="(-x)³+(3*x²)-(3*x)+1")
expression_2 = Expression(x=parameter_t, Expression="(3*x³)-(6*x²)+(3*x)")
expression_3 = Expression(x=parameter_t, Expression="(-3*x³)+(3*x²)")
expression_4 = Expression(x=parameter_t, Expression="(x³)")
merge = Merge(Data1=expression, Data2=expression_2, Data3=expression_3, Data4=expression_4)
multiplication = Multiplication(B=merge)
ma = MassAddition(Input=multiplication)  # -> Result, PartialResults
division = Division(A=multiplication, B=ma.Result)
format = Format(Format="{0:0.00}", Culture=127, Data0=division)

max = Maximum(A=division, B="0.00001")

# ----
# Weighted Average Lines
avr = Average(Input=points)
vec2pt = Vector2Pt(PointA=avr, PointB=points, Unitize=False)  # -> Vector, Length
# Skeleton Frame
multiplication_2 = Multiplication(A=max, B=vec2pt.Length)
line = LineSDL(Start=avr, Direction=vec2pt.Vector, Length=multiplication_2)
mpipe = MeshPipe(Curve=line, Radius="0.35", Accuracy=0.2, Rotation=0, Segments=10, Caps=2)

# ----
# Bezier Points & Spheres
number_slider_3 = Slider(1, range=0..1)
range = Range(Domain=number_slider_3, Steps=Slider(100, range=0..100))
expression_5 = Expression(
    A=item.Item,
    B=item.Item1,
    C=item.Item2,
    D=item.Item3,
    t=range,
    Expression="((1-t)³*A)+(3*(1-t)²*t*B)+(3*(1-t)*t²*C)+(t³*D)")
number_slider_4 = Slider(5.06, range=0..10)
number_slider_5 = Slider(20, range=0..20)

# ----
# Strings
B = Point(item.Item1)
A = Point(item.Item)
C = Point(item.Item2)
D = Point(item.Item3)
toggle = BooleanToggle(True)
ln = Line(StartPoint=[A, B, C, D], EndPoint=[B, C, D])
clean = CleanTree(RemoveNulls=toggle, RemoveInvalid=toggle, RemoveEmpty=toggle, Tree=ln)
eval = EvaluateCurve(Curve=graft(clean), Parameter=range)  # -> Point, Tangent, Angle
bang = ExplodeTree(Data=eval.Point)  # -> Branch0, Branch1, Branch2
ln_2 = Line(StartPoint=bang.Branch0, EndPoint=bang.Branch1)
ln_3 = Line(StartPoint=bang.Branch1, EndPoint=bang.Branch2)
eval_2 = EvaluateCurve(Curve=ln_2, Parameter=range)  # -> Point, Tangent, Angle
eval_3 = EvaluateCurve(Curve=ln_3, Parameter=range)  # -> Point, Tangent, Angle
ln_4 = Line(StartPoint=eval_2.Point, EndPoint=eval_3.Point)

starting_lines = Data(clean)

len = Length(Curve=starting_lines)
ma_2 = MassAddition(Input=len)  # -> Result, PartialResults
multiplication_3 = Multiplication(A=ma_2.Result, B=Slider(0.011, range=0..0.015))
multiplication_4 = Multiplication(A=format, B=multiplication_3)
msphere = MeshSphere(Base=points, Radius=multiplication_4, UCount=10, VCount=20)

merge_2 = Merge(
    Data1=ColourSwatch(SwatchColor=RGB(0, 93, 255)),
    Data2=ColourSwatch(SwatchColor=RGB(0, 153, 255)),
    Data3=ColourSwatch(SwatchColor=RGB(0, 225, 255)),
    Data4=ColourSwatch(SwatchColor=RGB(0, 255, 162)))
mcol = MeshColours(Mesh=graft(msphere), Colours=graft(merge_2))
mcol_2 = MeshColours(Mesh=graft(mpipe), Colours=graft(merge_2))
entwine = Entwine(Branch00=mcol, Branch01=mcol_2, FlattenInputs=True)

multiplication_5 = Multiplication(A=range, B=multiplication_3)
msphere_2 = MeshSphere(Base=expression_5, Radius=multiplication_5, UCount=number_slider_5, VCount=number_slider_5)

number_slider_6 = Slider(100, range=0..100)
number_slider_7 = Slider(1, range=0..1)
number_slider_8 = Slider(0, range=0..100)
gradient = Gradient(
    LowerLimit=number_slider_8,
    UpperLimit=number_slider_7,
    Parameter=range,
    stops=[0.15: RGB(255, 130, 160), 0.85: RGB(220, 0, 40)])
gradient_2 = Gradient(LowerLimit=number_slider_8, UpperLimit=number_slider_7, Parameter=range, stops=[0: RGB(255, 255, 255), 1: RGB(0, 0, 0)])
gradient_3 = Gradient(
    LowerLimit=number_slider_8,
    UpperLimit=number_slider_7,
    Parameter=range,
    stops=[0: RGB(234, 38, 0), 0.25: RGB(234, 126, 0), 0.5: RGB(254, 244, 84), 0.75: RGB(173, 203, 249), 1: RGB(75, 107, 169)])
entwine_2 = Entwine(Branch00=gradient, Branch01=gradient_2, Branch02=gradient_3, FlattenInputs=True)
bang_2 = ExplodeTree(Data=entwine_2)  # -> Branch0, Branch1, Branch2

color_scheme_2 = ColorScheme(t=range, G=0)

mpipe_2 = MeshPipe(Curve=ln_2, Radius=number_slider_2, Accuracy=number_slider, Rotation=0, Segments=10, Caps=2)
mpipe_3 = MeshPipe(Curve=ln_3, Radius=number_slider_2, Accuracy=number_slider, Rotation=0, Segments=10, Caps=2)
mpipe_4 = MeshPipe(Curve=ln_4, Radius=number_slider_2, Accuracy=number_slider, Rotation=0, Segments=10, Caps=2)
filter = StreamFilter(Gate=color_scheme, Stream0=bang_2.Branch0, Stream1=bang_2.Branch1, Stream2=bang_2.Branch2)
mcol_3 = MeshColours(Mesh=graft(mpipe_2), Colours=reverse(graft(filter)))
mcol_4 = MeshColours(Mesh=graft(mpipe_3), Colours=graft(filter))
mcol_5 = MeshColours(Mesh=graft(mpipe_4), Colours=graft(filter))
mcol_6 = MeshColours(Mesh=graft(msphere_2), Colours=graft(filter))

entwine_3 = Entwine(Branch00=mcol_3, Branch01=mcol_4, Branch02=mcol_5, FlattenInputs=True)

# ----
# Lines
eval_4 = EvaluateCurve(Curve=reparameterize(starting_lines), Parameter=parameter_t)  # -> Point, Tangent, Angle
shift = ShiftList(List=eval_4.Point, Shift=1, Wrap=invert(True))
short = ShortestList(ListA=eval_4.Point, ListB=shift, TrimMode=2)  # -> ListA, ListB
ln_5 = Line(StartPoint=short.ListA, EndPoint=short.ListB)
eval_5 = EvaluateCurve(Curve=reparameterize(ln_5), Parameter=parameter_t)  # -> Point, Tangent, Angle
shift_2 = ShiftList(List=eval_5.Point, Shift=1, Wrap=invert(True))
short_2 = ShortestList(ListA=eval_5.Point, ListB=shift_2, TrimMode=2)  # -> ListA, ListB
ln_6 = Line(StartPoint=short_2.ListA, EndPoint=short_2.ListB)
eval_6 = EvaluateCurve(Curve=reparameterize(ln_6), Parameter=parameter_t)  # -> Point, Tangent, Angle

# ----
# Drawn Curve
intcrv = Interpolate(Vertices=expression_5, Degree=3, Periodic=False, KnotStyle=1)  # -> Curve, Length, Domain
crv_cp = CurveClosestPoint(Point=eval_6.Point, Curve=reparameterize(intcrv.Curve))  # -> Point, Parameter, Distance
max_2 = Maximum(A=crv_cp.Parameter, B="0.000001")
shatter = Shatter(Curve=reparameterize(intcrv.Curve), Parameters=max_2)
item_2 = ListItem(List=shatter, Index=0, Wrap=True)
mpipe_5 = MeshPipe(Curve=item_2, Radius="1", Accuracy=number_slider, Rotation=0, Segments=10, Caps=2)

# ----
# Parameter Points
entwine_4 = Entwine(Branch00=eval_6.Point, Branch01=eval_5.Point, Branch02=eval_4.Point, FlattenInputs=True)
number_slider_9 = Slider(1.12, range=0..10)
merge_3 = Merge(Data1=number_slider_9, Data2=number_slider_9, Data3=number_slider_9)
mm = MassMultiplication(Input=merge_3)  # -> Result, reverse(PartialResults)
msphere_3 = MeshSphere(Base=entwine_4, Radius=graft(mm.PartialResults), UCount=10, VCount=20)

entwine_5 = Entwine(Branch00=intcrv.Curve, Branch01=starting_lines, Branch02=ln_5, Branch03=ln_6, FlattenInputs=True)
mpipe_6 = MeshPipe(Curve=entwine_5, Radius=number_slider_2, Accuracy=number_slider, Rotation=0, Segments=10, Caps=2)

merge_4 = Merge(
    Data1=ColourSwatch(SwatchColor=RGB(128, 126, 126)),
    Data2=ColourSwatch(SwatchColor=RGB(89, 89, 89)),
    Data3=ColourSwatch(SwatchColor=RGB(54, 54, 54)),
    Data4=ColourSwatch(SwatchColor=RGB(0, 0, 0)))
mcol_7 = MeshColours(Mesh=mpipe_5, Colours=graft(ColourSwatch(SwatchColor=RGB(255, 0, 0))))
mcol_8 = MeshColours(Mesh=msphere_3, Colours=graft(ColourSwatch(SwatchColor=RGB(0, 0, 0))))
mcol_9 = MeshColours(Mesh=mpipe_6, Colours=graft(merge_4))

entwine_6 = Entwine(Branch00=entwine, Branch01=mcol_7, Branch02=mcol_8, Branch03=mcol_9, FlattenInputs=True)
filter_2 = StreamFilter(Gate=view_type, Stream0=entwine_6, Stream1=entwine_3, Stream2=mcol_6)
context_bake = ContextBake(Geometry=filter_2)

# ==== cluster ColorScheme
number_slider = Slider(100, range=0..100)
t = ClusterInput()
number_slider_2 = Slider(1, range=0..1)
number_slider_3 = Slider(0, range=0..100)
gradient = Gradient(
    LowerLimit=number_slider_3,
    UpperLimit=number_slider_2,
    Parameter=t,
    stops=[0.15: RGB(255, 130, 160), 0.85: RGB(220, 0, 40)])
gradient_2 = Gradient(LowerLimit=number_slider_3, UpperLimit=number_slider_2, Parameter=t, stops=[0: RGB(255, 255, 255), 1: RGB(0, 0, 0)])
gradient_3 = Gradient(
    LowerLimit=number_slider_3,
    UpperLimit=number_slider_2,
    Parameter=t,
    stops=[0: RGB(234, 38, 0), 0.25: RGB(234, 126, 0), 0.5: RGB(254, 244, 84), 0.75: RGB(173, 203, 249), 1: RGB(75, 107, 169)])
entwine = Entwine(Branch00=gradient, Branch01=gradient_2, Branch02=gradient_3, FlattenInputs=True)
G = ClusterInput()
bang = ExplodeTree(Data=entwine)  # -> Branch0, Branch1, Branch2
filter = StreamFilter(Gate=G, Stream0=bang.Branch0, Stream1=bang.Branch1, Stream2=bang.Branch2)
s_0 = ClusterOutput(filter)
